# Grasshopper definition twist, levels, floors.gh (Grasshopper 1.0.7)
# plug-ins: Rhino.Inside for Autodesk Revit

floor_height = Slider(4000, range=0..10000)
no_floors = Slider(36, range=0..50)
series = Series(Start=0, Step=floor_height, Count=no_floors)
subtraction = Subtraction(A=no_floors, B="1")
curve = Curve(<curve referenced from the Rhino model>)
unit_z = UnitZ(Factor=series)
range = Range(Domain=Slider(0.99, range=0..1), Steps=no_floors)
move = Move(Geometry=curve, Motion=unit_z)  # -> Geometry, Transform
range_2 = Range(Domain=subtraction, Steps=subtraction)
graph_mapper = GraphMapper(
    range,
    x0=0,
    x1=1,
    y0=0,
    y1=1,
    container_name="Bezier",
    cpx=[0, 0.5666611791, 1, 1],
    cpy=[0.7401787043, 0.9796824455, 0.5750037432, 0])
area = Area(Geometry=move.Geometry)  # -> Area, Centroid
panel = Panel(range_2)
scale = Scale(Geometry=move.Geometry, Center=area.Centroid, Factor=graph_mapper)  # -> Geometry, Transform
format = Format(Format="Level {0}", Culture=127, Data0=range_2)
boolean_toggle = BooleanToggle(False)
data_dam = DataDam(DataDataA=series, DataA=format, DataB=boolean_toggle, BufferDelay=10000000, BufferMode=0)  # -> DataDataA, DataA, DataB
add_level = AddLevel(Elevation=data_dam.DataDataA, Name=data_dam.DataA, TrackingMode=2)
bounds = Bounds(Numbers=range)
construct_domain = ConstructDomain(DomainStart="0", DomainEnd="1")
total_twist = Slider(0, range=0..360)
remap_numbers = RemapNumbers(Value=range, Source=bounds, Target=construct_domain)  # -> Mapped, Clipped
multiplication = Multiplication(A=total_twist, B=remap_numbers.Mapped)
rotate = Rotate(Geometry=scale.Geometry, Angle=degrees(multiplication), Plane=area.Centroid)  # -> graft(Geometry), Transform
type = Type(<hostobjecttype referenced from the Revit model>, SelectedBuiltInCategory="autodesk.revit.category.local:floors")
data_dam_2 = DataDam(DataDataA=rotate.Geometry, DataA=type, DataB=boolean_toggle, DataC=Toggle(True), BufferDelay=10000000, BufferMode=0)  # -> DataDataA, DataA, DataB, DataC
add_floor = AddFloor(Boundary=data_dam_2.DataDataA, Type=data_dam_2.DataA, Level=add_level, Structural=Toggle(True), TrackingMode=2)
panel_2 = Panel(add_floor)
